% Simulink data dictionary sign_detector.sldd

BOOT_SEC = Simulink.Parameter(10, DataType="double", Min=0, Unit="s")  % 시작 대기 시간: 프로그램 시작 후 이 시간 안에 첫 인식 결과가 없으면 송신을 멈춤 (SWR-34)
CAN_PERIOD = Simulink.Parameter(0.1, Unit="s")  % 송신 주기 (SWR-04)
CONF_THRES = Simulink.Parameter(0.5, DataType="double", Min=0, Max=1)  % 신뢰도 기준: 이 값 이하인 인식 결과는 버림 (SWR-01)
INFER_PERIOD = Simulink.Parameter(0.05, Unit="s")  % 인식 주기 (SWR-21)
STALL_SEC = Simulink.Parameter(1, DataType="double", Min=0, Unit="s")  % 인식 정지 판정 시간: 직전 결과 이후 이 시간 이상 새 결과가 없으면 인식 정지 (SWR-32)
VOTE_K = Simulink.Parameter(3, DataType="double", Min=1, Max=64)  % 확정에 필요한 같은 표지판 프레임 수 K, K > N/2 (SWR-02, SWR-22)
VOTE_N = Simulink.Parameter(5, DataType="double", Min=1, Max=64)  % 확정 판단에 쓰는 최근 프레임 수 N (SWR-02, SWR-22). 큐 크기라 조정 불가(non-tunable)