% Requirement links of HilTest.m (R2026b)

% line 37 verifies requirements.slreqx#8
% line 37 verifies requirements.slreqx#9
% line 37 verifies requirements.slreqx#14
        function normalOperation(testCase)

% line 54 verifies requirements.slreqx#8
        function periodUnderCpuLoad(testCase)

% line 76 verifies requirements.slreqx#11
        function processingRate(testCase)

% line 94 verifies requirements.slreqx#14
% line 94 verifies requirements.slreqx#15
        function stallStopsSending(testCase)

% line 120 verifies requirements.slreqx#17
        function bootStatus(testCase)

% line 136 verifies requirements.slreqx#17
        function noModelStopsAfterBootTimeout(testCase)

% line 154 verifies requirements.slreqx#16
% line 154 verifies requirements.slreqx#14
        function canFailureKeepsRunning(testCase)