test file "sign_detector"
  coverage: Decision, MCDC, Condition

suite "integration"

  case "SWR22_sign_change_and_hold" [baseline]
    model sign_detector, stop time 4
    input "SWR22_sign_change_and_hold.mat", mapped to rgb (active)
    baseline "SWR22_sign_change_and_hold"
      send
      data:1

  case "SWR22_each_sign" [baseline]
    model sign_detector, stop time 5
    input "SWR22_each_sign.mat", mapped to rgb (active)
    baseline "SWR22_each_sign"
      send
      data:1