test file "unit_can_sender"
  coverage: Decision, MCDC, Condition

suite "can_sender"

  case "SWR11_bytes_follow_inputs" [baseline]
    model unit_can_sender, stop time 0.9
    input "SWR11_bytes_follow_inputs" from unit_can_sender.xlsx, mapped to limit, detected, ready, last_t, now (active)
    baseline "SWR11_bytes_follow_inputs"
      send:1
      data:1

  case "SWR11_out_of_range_zero" [baseline]
    model unit_can_sender, stop time 0.4
    input "SWR11_out_of_range_zero" from unit_can_sender.xlsx, mapped to limit, detected, ready, last_t, now (active)
    baseline "SWR11_out_of_range_zero"
      data:1

  case "SWR32_stop_1s_after_result" [baseline]
    model unit_can_sender, stop time 2
    input "SWR32_stop_1s_after_result" from unit_can_sender.xlsx, mapped to limit, detected, ready, last_t, now (active)
    baseline "SWR32_stop_1s_after_result"
      send:1
      data:1

  case "SWR34_preparing_10s" [baseline]
    model unit_can_sender, stop time 12
    input "SWR34_preparing_10s" from unit_can_sender.xlsx, mapped to limit, detected, ready, last_t, now (active)
    baseline "SWR34_preparing_10s"
      send:1
      data:1

  case "SWR34_first_result_status" [baseline]
    model unit_can_sender, stop time 5
    input "SWR34_first_result_status" from unit_can_sender.xlsx, mapped to limit, detected, ready, last_t, now (active)
    baseline "SWR34_first_result_status"
      send:1
      data:1

  case "SWR34_resume_after_timeout" [baseline]
    model unit_can_sender, stop time 15
    input "SWR34_resume_after_timeout" from unit_can_sender.xlsx, mapped to limit, detected, ready, last_t, now (active)
    baseline "SWR34_resume_after_timeout"
      send:1
      data:1

  case "SWR33_alive_continues" [baseline]
    model unit_can_sender, stop time 29.9
    input "SWR33_alive_continues" from unit_can_sender.xlsx, mapped to limit, detected, ready, last_t, now (active)
    baseline "SWR33_alive_continues"
      send:1
      data:1