test file "unit_decide"
  coverage: Decision, MCDC, Condition

suite "decide"

  case "SWR02_no_confirm_before_5" [baseline]
    model unit_decide, stop time 5
    input "SWR02_no_confirm_before_5" from unit_decide.xlsx, mapped to cls, now (active)
    post-load callback:
      set_param('unit_decide', 'FixedStep', '1');
    cleanup callback:
      set_param('unit_decide', 'FixedStep', 'auto');
    baseline "SWR02_no_confirm_before_5"
      speed_limit
      detected

  case "SWR02_3of5_consecutive" [baseline]
    model unit_decide, stop time 4
    input "SWR02_3of5_consecutive" from unit_decide.xlsx, mapped to cls, now (active)
    post-load callback:
      set_param('unit_decide', 'FixedStep', '1');
    cleanup callback:
      set_param('unit_decide', 'FixedStep', 'auto');
    baseline "SWR02_3of5_consecutive"
      speed_limit
      detected

  case "SWR02_3of5_scattered" [baseline]
    model unit_decide, stop time 9
    input "SWR02_3of5_scattered" from unit_decide.xlsx, mapped to cls, now (active)
    post-load callback:
      set_param('unit_decide', 'FixedStep', '1');
    cleanup callback:
      set_param('unit_decide', 'FixedStep', 'auto');
    baseline "SWR02_3of5_scattered"
      speed_limit
      detected

  case "SWR02_2of5_no_confirm" [baseline]
    model unit_decide, stop time 19
    input "SWR02_2of5_no_confirm" from unit_decide.xlsx, mapped to cls, now (active)
    post-load callback:
      set_param('unit_decide', 'FixedStep', '1');
    cleanup callback:
      set_param('unit_decide', 'FixedStep', 'auto');
    baseline "SWR02_2of5_no_confirm"
      speed_limit
      detected

  case "SWR02_empty_frames_count" [baseline]
    model unit_decide, stop time 14
    input "SWR02_empty_frames_count" from unit_decide.xlsx, mapped to cls, now (active)
    post-load callback:
      set_param('unit_decide', 'FixedStep', '1');
    cleanup callback:
      set_param('unit_decide', 'FixedStep', 'auto');
    baseline "SWR02_empty_frames_count"
      speed_limit
      detected

  case "SWR02_two_misdetections" [baseline]
    model unit_decide, stop time 8
    input "SWR02_two_misdetections" from unit_decide.xlsx, mapped to cls, now (active)
    post-load callback:
      set_param('unit_decide', 'FixedStep', '1');
    cleanup callback:
      set_param('unit_decide', 'FixedStep', 'auto');
    baseline "SWR02_two_misdetections"
      speed_limit
      detected

  case "SWR02_two_misses" [baseline]
    model unit_decide, stop time 8
    input "SWR02_two_misses" from unit_decide.xlsx, mapped to cls, now (active)
    post-load callback:
      set_param('unit_decide', 'FixedStep', '1');
    cleanup callback:
      set_param('unit_decide', 'FixedStep', 'auto');
    baseline "SWR02_two_misses"
      speed_limit
      detected

  case "SWR02_one_miss" [baseline]
    model unit_decide, stop time 7
    input "SWR02_one_miss" from unit_decide.xlsx, mapped to cls, now (active)
    post-load callback:
      set_param('unit_decide', 'FixedStep', '1');
    cleanup callback:
      set_param('unit_decide', 'FixedStep', 'auto');
    baseline "SWR02_one_miss"
      speed_limit
      detected

  case "SWR02_one_misdetection" [baseline]
    model unit_decide, stop time 7
    input "SWR02_one_misdetection" from unit_decide.xlsx, mapped to cls, now (active)
    post-load callback:
      set_param('unit_decide', 'FixedStep', '1');
    cleanup callback:
      set_param('unit_decide', 'FixedStep', 'auto');
    baseline "SWR02_one_misdetection"
      speed_limit
      detected

  case "SWR02_miss_and_misdetection" [baseline]
    model unit_decide, stop time 8
    input "SWR02_miss_and_misdetection" from unit_decide.xlsx, mapped to cls, now (active)
    post-load callback:
      set_param('unit_decide', 'FixedStep', '1');
    cleanup callback:
      set_param('unit_decide', 'FixedStep', 'auto');
    baseline "SWR02_miss_and_misdetection"
      speed_limit
      detected

  case "SWR02_separated_misdetections" [baseline]
    model unit_decide, stop time 8
    input "SWR02_separated_misdetections" from unit_decide.xlsx, mapped to cls, now (active)
    post-load callback:
      set_param('unit_decide', 'FixedStep', '1');
    cleanup callback:
      set_param('unit_decide', 'FixedStep', 'auto');
    baseline "SWR02_separated_misdetections"
      speed_limit
      detected

  case "SWR02_same_sign_2plus2" [baseline]
    model unit_decide, stop time 9
    input "SWR02_same_sign_2plus2" from unit_decide.xlsx, mapped to cls, now (active)
    post-load callback:
      set_param('unit_decide', 'FixedStep', '1');
    cleanup callback:
      set_param('unit_decide', 'FixedStep', 'auto');
    baseline "SWR02_same_sign_2plus2"
      speed_limit
      detected

  case "SWR02_same_sign_3_among_others" [baseline]
    model unit_decide, stop time 9
    input "SWR02_same_sign_3_among_others" from unit_decide.xlsx, mapped to cls, now (active)
    post-load callback:
      set_param('unit_decide', 'FixedStep', '1');
    cleanup callback:
      set_param('unit_decide', 'FixedStep', 'auto');
    baseline "SWR02_same_sign_3_among_others"
      speed_limit
      detected

  case "SWR02_each_class" [baseline]
    model unit_decide, stop time 13
    input "SWR02_each_class" from unit_decide.xlsx, mapped to cls, now (active)
    post-load callback:
      set_param('unit_decide', 'FixedStep', '1');
    cleanup callback:
      set_param('unit_decide', 'FixedStep', 'auto');
    baseline "SWR02_each_class"
      speed_limit
      detected

  case "SWR11_detected_last_five" [baseline]
    model unit_decide, stop time 8
    input "SWR11_detected_last_five" from unit_decide.xlsx, mapped to cls, now (active)
    post-load callback:
      set_param('unit_decide', 'FixedStep', '1');
    cleanup callback:
      set_param('unit_decide', 'FixedStep', 'auto');
    baseline "SWR11_detected_last_five"
      speed_limit
      detected

  case "SWR02_new_sign_replaces" [baseline]
    model unit_decide, stop time 7
    input "SWR02_new_sign_replaces" from unit_decide.xlsx, mapped to cls, now (active)
    post-load callback:
      set_param('unit_decide', 'FixedStep', '1');
    cleanup callback:
      set_param('unit_decide', 'FixedStep', 'auto');
    baseline "SWR02_new_sign_replaces"
      speed_limit
      detected

  case "SWR03_keeps_limit" [baseline]
    model unit_decide, stop time 24
    input "SWR03_keeps_limit" from unit_decide.xlsx, mapped to cls, now (active)
    post-load callback:
      set_param('unit_decide', 'FixedStep', '1');
    cleanup callback:
      set_param('unit_decide', 'FixedStep', 'auto');
    baseline "SWR03_keeps_limit"
      speed_limit
      detected

  case "SWR02_stall_clears_record" [baseline]
    model unit_decide, stop time 9
    input "SWR02_stall_clears_record" from unit_decide.xlsx, mapped to cls, now (active)
    post-load callback:
      set_param('unit_decide', 'FixedStep', '1');
    cleanup callback:
      set_param('unit_decide', 'FixedStep', 'auto');
    baseline "SWR02_stall_clears_record"
      speed_limit
      detected

  case "SWR02_gap_under_1s" [baseline]
    model unit_decide, stop time 5
    input "SWR02_gap_under_1s" from unit_decide.xlsx, mapped to cls, now (active)
    post-load callback:
      set_param('unit_decide', 'FixedStep', '1');
    cleanup callback:
      set_param('unit_decide', 'FixedStep', 'auto');
    baseline "SWR02_gap_under_1s"
      speed_limit
      detected

  case "SWR22_confirm_5fps" [baseline]
    model unit_decide, stop time 9
    input "SWR22_confirm_5fps" from unit_decide.xlsx, mapped to cls, now (active)
    post-load callback:
      set_param('unit_decide', 'FixedStep', '1');
    cleanup callback:
      set_param('unit_decide', 'FixedStep', 'auto');
    baseline "SWR22_confirm_5fps"
      speed_limit
      detected

  case "SWR22_confirm_8fps" [baseline]
    model unit_decide, stop time 9
    input "SWR22_confirm_8fps" from unit_decide.xlsx, mapped to cls, now (active)
    post-load callback:
      set_param('unit_decide', 'FixedStep', '1');
    cleanup callback:
      set_param('unit_decide', 'FixedStep', 'auto');
    baseline "SWR22_confirm_8fps"
      speed_limit
      detected

  case "SWR22_confirm_15fps" [baseline]
    model unit_decide, stop time 9
    input "SWR22_confirm_15fps" from unit_decide.xlsx, mapped to cls, now (active)
    post-load callback:
      set_param('unit_decide', 'FixedStep', '1');
    cleanup callback:
      set_param('unit_decide', 'FixedStep', 'auto');
    baseline "SWR22_confirm_15fps"
      speed_limit
      detected

  case "SWR22_after_start" [baseline]
    model unit_decide, stop time 5
    input "SWR22_after_start" from unit_decide.xlsx, mapped to cls, now (active)
    post-load callback:
      set_param('unit_decide', 'FixedStep', '1');
    cleanup callback:
      set_param('unit_decide', 'FixedStep', 'auto');
    baseline "SWR22_after_start"
      speed_limit
      detected

  case "SWR22_after_stall" [baseline]
    model unit_decide, stop time 11
    input "SWR22_after_stall" from unit_decide.xlsx, mapped to cls, now (active)
    post-load callback:
      set_param('unit_decide', 'FixedStep', '1');
    cleanup callback:
      set_param('unit_decide', 'FixedStep', 'auto');
    baseline "SWR22_after_stall"
      speed_limit
      detected

  case "SWR02_invalid_class" [baseline]
    model unit_decide, stop time 7
    input "SWR02_invalid_class" from unit_decide.xlsx, mapped to cls, now (active)
    post-load callback:
      set_param('unit_decide', 'FixedStep', '1');
    cleanup callback:
      set_param('unit_decide', 'FixedStep', 'auto');
    baseline "SWR02_invalid_class"
      speed_limit
      detected